# Grasshopper definition creating tree plans.gh (Grasshopper 1.0.7)

point = Point([<point referenced from the Rhino model> x39])

list_length = ListLength(List=point)
construct_domain = ConstructDomain(DomainStart=Slider(10, range=0..10), DomainEnd=Slider(5.989, range=0..10))
random = Random(Range=construct_domain, Number=list_length, Seed=2)
graft_tree = GraftTree(Tree=random, IncludeEmptyLists=True, IncludeNullItems=True)
panel = Panel(random)

graft_tree_2 = GraftTree(Tree=point, IncludeEmptyLists=True, IncludeNullItems=True)
circle_cnr = CircleCNR(Center=graft_tree_2, Normal=Vector(0, 0, 1), Radius=graft_tree)
circle_cnr_2 = CircleCNR(Center=graft_tree_2, Normal=Vector(0, 0, 1), Radius=Slider(1.628, range=0..40))
evaluate_curve = EvaluateCurve(Curve=circle_cnr, Parameter=[Slider(15.907, range=0..40), Slider(21.997, range=0..40)])  # -> Point, Tangent, Angle
line = Line(StartPoint=graft_tree_2, EndPoint=evaluate_curve.Point)

list_length_2 = ListLength(List=point)
number_slider = Slider(7, range=0..10)
random_2 = Random(Range="360", Number=list_length_2, Seed="420420")
panel_2 = Panel(random_2)
graft_tree_3 = GraftTree(Tree=random_2, IncludeEmptyLists=True, IncludeNullItems=True)

trim_with_region = TrimWithRegion(Curve=line, Region=circle_cnr_2)  # -> Inside, Outside
number_slider_2 = Slider(97.016, range=0..360)
curve = Curve(trim_with_region.Outside)
shift_paths = ShiftPaths(Data=curve, Offset="-1")
rotate = Rotate(Geometry=shift_paths, Angle=degrees(graft_tree_3), Plane=circle_cnr)  # -> Geometry, Transform
panel_3 = Panel("randomize branch angle")
scale = Scale(Center=Point(0, 0, 0), Factor=0.5)  # -> Geometry, Transform
